# Dynamo graph ApiRest.PatternLang.dyn (Dynamo 1.3.3.4111)

# group: Web request
string = StringInput("https://patternlang.herokuapp.com/pattern")
byUrl = DynaWeb.WebRequest.ByUrl(string)
string_2 = StringInput("GET")
setMethod = DynaWeb.WebRequest.SetMethod(byUrl, string_2)
string_3 = StringInput("Content-Type")
string_4 = StringInput("application/json")
addHeader = DynaWeb.WebRequest.AddHeader(setMethod, string_3, string_4)
execute = DynaWeb.WebRequest.Execute(addHeader)
content = DynaWeb.WebResponse.Content(execute)
deserialise = DynaWeb.Helpers.Deserialise(content)
watch = Watch(deserialise)
time = DynaWeb.WebResponse.Time(execute)
contentType = DynaWeb.WebResponse.ContentType(execute)

# group: Get data
flatten = Flatten(deserialise)
code_block = CodeBlock(l=flatten) { l[1]; }
flatten_2 = Flatten(code_block)

# group: Set data
categories = Categories("Walls")
all_elements_of_category = ElementsOfCategory(categories)
code_block_2 = CodeBlock { "Comments"; }
setParameterByName = Element.SetParameterByName(element=all_elements_of_category, parameterName=code_block_2, value=flatten_2, lacing=CrossProduct)
