# Dynamo graph Background.GetSquareFeetFromModels.dyn (Dynamo 0.9.1.4062)

# group: Set Directory path
directory_path = Directory("C:\Users\fpossetto\Desktop\WW-Counter\Testing")
code_block = CodeBlock { "*.rvt"; }
# note: Get Files
python_script = Python(IN[0]=directory_path, IN[1]=code_block)
# ---------- python_script.python (9 lines) ----------
from System.IO import Directory, SearchOption

directory = IN[0]
searchstring = IN[1]

if Directory.Exists(directory):
	OUT = Directory.GetFiles(directory, searchstring, SearchOption.AllDirectories)
else:
	OUT = list()
# ----------------------------------------
# note: All Sq ft per projects
python_script_2 = Python(IN[0]=python_script)
# ---------- python_script_2.python (35 lines) ----------
import clr
clr.AddReference('ProtoGeometry')
from Autodesk.DesignScript.Geometry import *

clr.AddReference('RevitAPI')
from Autodesk.Revit.DB import FilteredElementCollector, BuiltInCategory, Element, Parameter, FormatOptions, Transaction
from Autodesk.Revit.ApplicationServices.Application import OpenDocumentFile

# Import DocumentManager and TransactionManager
clr.AddReference("RevitServices")
import RevitServices
from RevitServices.Persistence import DocumentManager
from RevitServices.Transactions import TransactionManager

doc = DocumentManager.Instance.CurrentDBDocument
uiapp = DocumentManager.Instance.CurrentUIApplication
app = uiapp.Application

file_path = IN[0]
values = []

floor_list = []
#Get all floor.
for f in file_path:
	doc = app.OpenDocumentFile(str(f));
	floor_collector = FilteredElementCollector(doc).OfCategory(BuiltInCategory.OST_Floors).WhereElementIsNotElementType().ToElements()
	_values = 0
	
	#Get the area.
	for e in floor_collector:
		parameter = e.LookupParameter("Area")
		value = parameter.AsDouble()
		_values = _values + value
	values.append(_values)	
OUT = values, floor_list
# ----------------------------------------
project_names = Python(IN[0]=python_script)
# ---------- project_names.python (18 lines) ----------
import clr
clr.AddReference('ProtoGeometry')
from Autodesk.DesignScript.Geometry import *
#The inputs to this node will be stored as a list in the IN variables.
files = IN[0]
names = []
for f in files:
	last = len(f.split("\\"))-1
	name = f.split("\\")
	names.append(name[last])
	_names = []
	
	for n in names:
		_name = n.split(".")
		_names.append(_name[0])
		
#Assign your output to the OUT variable.
OUT = _names
# ----------------------------------------

# group: Get level and area for each floor
python_script_3 = Python(IN[0]=python_script)
# ---------- python_script_3.python (66 lines) ----------
import clr
clr.AddReference('ProtoGeometry')
from Autodesk.DesignScript.Geometry import *

clr.AddReference('RevitAPI')
from Autodesk.Revit.DB import FilteredElementCollector, BuiltInCategory, Element, Parameter, FormatOptions, Transaction, HostObject
from Autodesk.Revit.ApplicationServices.Application import OpenDocumentFile

# Import DocumentManager and TransactionManager
clr.AddReference("RevitServices")
import RevitServices
from RevitServices.Persistence import DocumentManager
from RevitServices.Transactions import TransactionManager

uiapp = DocumentManager.Instance.CurrentUIApplication
app = uiapp.Application

file_path = IN[0]
values = []
project_levels = []
project_floors = []
fran = []
for f in file_path:
	_list1 = []
	_list2 = []
	doc = app.OpenDocumentFile(str(f));
	floor_collector = FilteredElementCollector(doc).OfCategory(BuiltInCategory.OST_Floors).WhereElementIsNotElementType().ToElements()
	level_collector = FilteredElementCollector(doc).OfCategory(BuiltInCategory.OST_Levels).WhereElementIsNotElementType().ToElements()
	
	
	max_level= []
	elevations = []
	max_elevations = []
	
	name_list = []
	elevation_list = []
	area_list = []
	level_list=[]
	
	for f in floor_collector:
		param_1 = f.LookupParameter("Area")
		area = param_1.AsDouble()
		area_list.append(area)
		
		param_1 = f.LookupParameter("Level")
		level = param_1.AsValueString()
		level_list.append(level)
	#Get all project levels.
	for l in level_collector:
		#names
		param_1 = l.LookupParameter("Name")
		name = param_1.AsString()
		name_list.append(str(name))
		#elevations
		param_2 = l.LookupParameter("Elevation")
		elevation = param_2.AsDouble()
		elevation_list.append(str(elevation))
		
	_list1.append(name_list)
	_list1.append(elevation_list)
	_list2.append(level_list)
	_list2.append(area_list)
	project_levels.append(_list1)		
	project_floors.append(_list2)

OUT = project_levels, project_floors
# ----------------------------------------
project_floors = CodeBlock(y=python_script_3) { y[1]; }
transpose = List.Transpose(project_floors)
project_levels = CodeBlock(x=python_script_3) { x[0]; }
transpose_2 = List.Transpose(project_levels)

# group: Without Ghost levels
# note: Levels in use
python_script_4 = Python(IN[0]=python_script)
# ---------- python_script_4.python (46 lines) ----------
import clr
clr.AddReference('ProtoGeometry')
from Autodesk.DesignScript.Geometry import *

clr.AddReference('RevitAPI')
from Autodesk.Revit.DB import FilteredElementCollector, BuiltInCategory, Element, Parameter, FormatOptions, Transaction, HostObject
from Autodesk.Revit.ApplicationServices.Application import OpenDocumentFile

# Import DocumentManager and TransactionManager
clr.AddReference("RevitServices")
import RevitServices
from RevitServices.Persistence import DocumentManager
from RevitServices.Transactions import TransactionManager

uiapp = DocumentManager.Instance.CurrentUIApplication
app = uiapp.Application

file_path = IN[0]
levels_in_use = []

for f in file_path:
	_list1 = []
		
	doc = app.OpenDocumentFile(str(f));
	wall_collector = FilteredElementCollector(doc).OfCategory(BuiltInCategory.OST_Walls).WhereElementIsNotElementType().ToElements()
	
	
	name_list = []
	
	for w in wall_collector:
		#names
		param = w.LookupParameter("Base Constraint")
		try:
			name = param.AsValueString()
			if name in name_list:
				pass
			else:
				name_list.append(str(name))
		except:
			print("Error")
	_list1.append(name_list)
	levels_in_use.append(_list1)	

	

OUT = levels_in_use
# ----------------------------------------
flatten = Flatten(python_script_4)
# note: Drop Ghost levels
python_script_5 = Python(IN[0]=flatten, IN[1]=transpose)
# ---------- python_script_5.python (19 lines) ----------
import clr
clr.AddReference('ProtoGeometry')
from Autodesk.DesignScript.Geometry import *
#The inputs to this node will be stored as a list in the IN variables.

floor_level_area = IN[1]
levels_in_use = IN[0]

levels = []

for floor in floor_level_area:
	level = []
	index = floor_level_area.index(floor)
	for f in floor:
		if f[0] in levels_in_use[index]:
			level.append(f)
	levels.append(level)
#Assign your output to the OUT variable.
OUT = levels
# ----------------------------------------

# group: Make list with three values
python_script_6 = Python(IN[0]=python_script_5, IN[1]=project_names)
# ---------- python_script_6.python (19 lines) ----------
import clr
clr.AddReference('ProtoGeometry')
from Autodesk.DesignScript.Geometry import *

floors = IN[0]
projects = IN[1]
_list = []
indexes = []

for floor in floors:
	i = projects[floors.index(floor)]
	indexes.append(i)
	for f in floor:
		sublist = []
		sublist.append(f)
		_list.append(sublist)
		_list.append(i)
#Assign your output to the OUT variable.
OUT = _list
# ----------------------------------------
code_block_2 = CodeBlock { 3; }
flatten_2 = List.Flatten(list=python_script_6, amt=code_block_2)
code_block_3 = CodeBlock { 0..2; }
code_block_4 = CodeBlock { 3; }
sublists = List.Sublists(list=flatten_2, ranges=code_block_3, offset=code_block_4)
count = Count(flatten_2)

# group: Set Names and values in excel
excel_file = Filename(".\excel_template.xlsx")
sheet_name = CodeBlock { "Sheet1"; }
code_block_5 = CodeBlock { 0; }
writeToFile = Excel.WriteToFile(filePath=excel_file, sheetName=sheet_name, startRow=code_block_5, startCol=code_block_5, data=sublists)

# group: Without Last level
python_script_7 = Python(IN[0]=transpose_2, IN[1]=transpose)
# ---------- python_script_7.python (20 lines) ----------
import clr
clr.AddReference('ProtoGeometry')
from Autodesk.DesignScript.Geometry import *
#The inputs to this node will be stored as a list in the IN variables.
project_levels = IN[0]
project_floors = IN[1]
elevations = []

for level in project_levels:
	_list = []
	for l in level:
		_max = 0.0
		_lev = ""
		_list
		if l[1]>max:
			_max = l[1]		
			_lev = l[0]
	elevations.append(_lev)
#Assign your output to the OUT variable.
OUT = elevations
# ----------------------------------------
python_script_8 = Python(IN[0]=python_script_7, IN[1]=transpose)
# ---------- python_script_8.python (21 lines) ----------
import clr
clr.AddReference('ProtoGeometry')
from Autodesk.DesignScript.Geometry import *
#The inputs to this node will be stored as a list in the IN variables.
highest_levels = IN[0]
floors = IN[1]
new_list = []
new_list2 = []
for floor in floors:
	_list=[]
	_nolist = []
	for f in floor:
		if str(f[0]) is str(highest_levels[floors.index(floor)]):
			_list.append(f)
		else:
			_nolist.append(f)		
	new_list.append(_list)	
	new_list2.append(_nolist)	

#Assign your output to the OUT variable.
OUT = new_list2
# ----------------------------------------
