# Dynamo graph Doors.SortAsClockwise.dyn (Dynamo 1.3.4.6666)

# group: Select Doors
categories = Categories("Doors")
all_elements_of_category = ElementsOfCategory(categories)
python_script = Python(IN[0]=all_elements_of_category)
# ---------- python_script.python (21 lines) ----------
import clr

clr.AddReference('RevitAPI')
import Autodesk
from Autodesk.Revit.DB import Element

clr.AddReference("RevitNodes")
import Revit
clr.ImportExtensions(Revit.GeometryConversion)

#The inputs to this node will be stored as a list in the IN variables.
doors = UnwrapElement(IN[0])
result = []

for d in doors:
	loc= d.Location
	point= loc.Point.ToPoint()
	result.append(loc.Point.ToPoint())
	
#Assign your output to the OUT variable.
OUT = result
# ----------------------------------------

# group: Room Center
select_model_element = DSModelElementSelection()
centerBoundary = Room.CenterBoundary(select_model_element)
startPoint = Curve.StartPoint(centerBoundary)
byPoints = Polygon.ByPoints(startPoint)
center = Polygon.Center(byPoints)

byTwoPoints = Vector.ByTwoPoints(start=center, end=python_script, lacing=Longest)
code_block = CodeBlock(v=byTwoPoints) { v[0]; }
ZAxis = Vector.ZAxis()
angleAboutAxis = Vector.AngleAboutAxis(code_block, byTwoPoints, ZAxis)
sortByKey = List.SortByKey(list=all_elements_of_category, keys=angleAboutAxis)
code_block_2 = CodeBlock { "Mark"; }
count = Count(all_elements_of_category)
code_block_3 = CodeBlock(a=count) { 0..a; }
string_from_object = FromObject(code_block_3)
setParameterByName = Element.SetParameterByName(element=sortByKey.sorted_list, parameterName=code_block_2, value=string_from_object)
