# Dynamo graph Elevation.CreateFromLine.dyn (Dynamo 1.3.2.2480)

# group: Section 1
# note: Select the Model Lines to Create Elevations
select_model_elements = DSModelElementsSelection()  # 3 picked in the model
curve = CurveElement.Curve(select_model_elements)
code_block = CodeBlock { 0.5; }
coordinateSystemAtParameter = Curve.CoordinateSystemAtParameter(curve, code_block)
byCartesianCoordinates = Point.ByCartesianCoordinates(coordinateSystemAtParameter)
XAxis = Plane.XAxis(coordinateSystemAtParameter)
startPoint = Curve.StartPoint(curve)
endPoint = Curve.EndPoint(curve)
create = List.Create(startPoint, endPoint)
transpose = List.Transpose(create)

# group: Section2
# note: Set Elevation Marker Offset from Model Line
# note: distancia crop
number_slider = DoubleSlider(-1887.3, range=-2000..2000 step 0.1)
# note: Elevation Marker Point
translate = Geometry.Translate(geometry=byCartesianCoordinates, direction=XAxis, distance=number_slider)
# note: Elevation Crop Bounday Points
translate_2 = Geometry.Translate(geometry=transpose, direction=XAxis, distance=number_slider)
transpose_2 = List.Transpose(translate_2)
firstItem = List.FirstItem(transpose_2)
lastItem = List.LastItem(transpose_2)
byStartPointEndPoint = Line.ByStartPointEndPoint(startPoint=firstItem, endPoint=lastItem)
# note: Set Boundary Extension
code_block_2 = CodeBlock { 0; }
# note: Alarga la linea
extendEnd = Curve.ExtendEnd(curve=byStartPointEndPoint, distance=code_block_2)
extendStart = Curve.ExtendStart(curve=extendEnd, distance=code_block_2)
startPoint_2 = Curve.StartPoint(extendStart)
endPoint_2 = Curve.EndPoint(extendStart)
create_2 = List.Create(startPoint_2, endPoint_2)
transpose_3 = List.Transpose(create_2)

# group: Section 3
ZAxis = Vector.ZAxis()
# note: Lower Extent of Elevation from F.L.
number_slider_2 = DoubleSlider(-200, range=-2000..2000 step 0.1)
translate_3 = Geometry.Translate(geometry=transpose_3, direction=ZAxis, distance=number_slider_2)
transpose_4 = List.Transpose(translate_3)
lastItem_2 = List.LastItem(transpose_4)
# note: Upper Extent of Elevation from F.L.
# note: Alto de crop
number_slider_3 = DoubleSlider(1000, range=-2000..20000 step 0.1)
translate_4 = Geometry.Translate(geometry=transpose_3, direction=ZAxis, distance=number_slider_3)
transpose_5 = List.Transpose(translate_4)
lastItem_3 = List.LastItem(transpose_5)
firstItem_2 = List.FirstItem(transpose_5)
firstItem_3 = List.FirstItem(transpose_4)
create_3 = List.Create(lastItem_2, lastItem_3, firstItem_2, firstItem_3)
transpose_6 = List.Transpose(create_3)
boolean = BoolSelector(true)
byPoints = PolyCurve.ByPoints(points=transpose_6, connectLastToFirst=boolean)
curves = PolyCurve.Curves(byPoints)

# group: Section 4
boolean_2 = BoolSelector(true)
# note: Eligo interior elevation o building elevation
python_script = Python()  # unwired: IN[0]
# ---------- python_script.python (43 lines) ----------
#Copyright(c) 2016 www.Learndynamo.com 
#Please contact at jeremy@learndynamo.com

import clr
clr.AddReference('RevitAPI')
clr.AddReference("RevitServices")
clr.AddReference("RevitNodes")
import RevitServices
import Revit
import Autodesk
from Autodesk.Revit.DB import *
from math import *

clr.ImportExtensions(Revit.GeometryConversion)

from RevitServices.Persistence import DocumentManager
from RevitServices.Transactions import TransactionManager

doc = DocumentManager.Instance.CurrentDBDocument

toggle = IN[0]

elements = []
names = []
lst = []

#Get Family View Type
vft = 0
collector = FilteredElementCollector(doc).OfClass(ViewFamilyType).ToElements()

#eleViews = []
for i in collector:
	if i.ViewFamily == ViewFamily.Elevation:
		elements.append(i)
		#elements.append(i.Name)
		for j in i.Parameters:
			if j.Definition.Name == "Type Name":
				names.append(j.AsString())
		
lst.append(elements)
lst.append(names)
	
OUT = lst
# ----------------------------------------
code_block_3 = CodeBlock(item=python_script) { item[0][0]; }
python_script_2 = Python(IN[0]=boolean_2, IN[1]=translate, IN[2]=byCartesianCoordinates, IN[3]=curves, IN[4]=code_block_3)
# ---------- python_script_2.python (102 lines) ----------
#Copyright(c) 2016 www.Learndynamo.com 
#Please contact at jeremy@learndynamo.com

import clr
clr.AddReference('RevitAPI')
clr.AddReference("RevitServices")
clr.AddReference("RevitNodes")
import RevitServices
import Revit
import Autodesk
from Autodesk.Revit.DB import *
from math import *

clr.ImportExtensions(Revit.GeometryConversion)

from RevitServices.Persistence import DocumentManager
from RevitServices.Transactions import TransactionManager

doc = DocumentManager.Instance.CurrentDBDocument

toggle = IN[0]
points = UnwrapElement(IN[1])
modelPoints = UnwrapElement(IN[2])
cropCurves = UnwrapElement(IN[3])
viewType = UnwrapElement(IN[4])

lst = []

#Get Family View Type
vft = 0
collector = FilteredElementCollector(doc).OfClass(ViewFamilyType).ToElements()

#eleViews = []
for i in collector:
	if i.ViewFamily == ViewFamily.Elevation:		
		vft = i.Id
		break
 
if toggle == True:
	
	TransactionManager.Instance.EnsureInTransaction(doc)
	
	for ind, point in enumerate(points):
	
		#Retrieve the mid point of model lines and get X,Y.		
		modelMP = modelPoints[ind].ToXyz()
		modelMPX = modelMP.X
		modelMPY = modelMP.Y
		
		#Retrieve individual lines of crop window.		
		cropLines = cropCurves[ind]
		l1 = cropLines[0].ToRevitType()
		l2 = cropLines[1].ToRevitType()
		l3 = cropLines[2].ToRevitType()
		l4 = cropLines[3].ToRevitType()
					
		# Create a line in the z-Axis for elevation marker to rotate around.			
		elevationPT = point.ToXyz()
		elptRotate = XYZ(elevationPT.X, elevationPT.Y, elevationPT.Z+10000)
		ln = Line.CreateBound(elevationPT, elptRotate)

		#Calculate the angle between Model Mid Point and Elevation Point.
		elevationPTY = elevationPT.Y
		elevationPTX = elevationPT.X							
		combY = elevationPTY-modelMPY
		combX = elevationPTX-modelMPX			
		ang = atan2(combY, combX)

		#Create elevation marker and elevation in position 0.
		eleMarker = ElevationMarker.CreateElevationMarker(doc, viewType.Id, elevationPT, 1000)
		ele = eleMarker.CreateElevation(doc, doc.ActiveView.Id , 0)
		
		#Rotate elevation marker towars model line.
		ElementTransformUtils.RotateElement(doc, eleMarker.Id, ln, ang)
		
		#	
		crManager = ele.GetCropRegionShapeManager()
		#crShape = crManager.GetCropRegionShape()

		newCurveLoop = []
		newCurveLoop.Add(l1)
		newCurveLoop.Add(l2)
		newCurveLoop.Add(l3)
		newCurveLoop.Add(l4)
			
		cLoop = CurveLoop.Create(newCurveLoop)

		try:			
			crManager.SetCropShape(cLoop)
			lst.append("Elevation Created")
		
		except:
			pass
			lst.append("Missed Elevation")

	TransactionManager.Instance.TransactionTaskDone()
	
	OUT = lst
	
else:

	OUT = "Set toggle to TRUE"
# ----------------------------------------
watch = Watch(python_script_2)

watch_2 = Watch(create)
watch_3 = Watch(transpose)
