# Dynamo graph FamilyType.SetValue.dyn (Dynamo 0.9.1.4062)

wall_types = WallTypes("Generic - 250mm")
all_elements_of_family_type = Custom[All Elements of Family Type (Universal)](Family_Type_s=wall_types)  # Unlike the built-in node, this node retrieves all placed instances of a given loadable *or* system family type
string = StringInput("Comments")
string_2 = StringInput("Hola!")
setParameterByName = Element.SetParameterByName(element=all_elements_of_family_type, parameterName=string, value=string_2)
getParameterValueByName = Element.GetParameterValueByName(element=all_elements_of_family_type, parameterName=string)
count = Count(getParameterValueByName)
