# Dynamo graph Filter.ElementByColor.dyn (Dynamo 0.9.1.4062)

categories = Categories("Walls")
all_elements_of_category = ElementsOfCategory(categories)
code_block = CodeBlock { "Comments"; }
getParameterValueByName = Element.GetParameterValueByName(element=all_elements_of_category, parameterName=code_block)
flatten = Flatten(getParameterValueByName)
file_path = Filename("C:\Users\Francisco\Desktop\dynamo\dynScripts\dynColor\dynColor.xlsx")
fromPath = FileObject(file_path)  # "File.FromPath"
code_block_2 = CodeBlock { "Hoja1"; }
readFromFile = Excel.ReadFromFile(file=fromPath, sheetName=code_block_2)
transpose = List.Transpose(readFromFile)
code_block_3 = CodeBlock(v=transpose) { v; l1 = v[0]; l2 = v[1]; }
code_block_4 = CodeBlock { "False"; }
switch = Custom[Switch](cases=code_block_3.l1, values=code_block_3.l2, default=code_block_4)  # Emulates the Switch/Case statement that is available in multiple programming languages.
map = List.Map(list=flatten, f_x=switch)
watch = Watch(map)
code_block_5 = CodeBlock { "Mark"; }
setParameterByName = Element.SetParameterByName(element=all_elements_of_category, parameterName=code_block_5, value=map)
watch_2 = Watch(code_block_3.l2)
watch_3 = Watch(code_block_3.l1)
