# Dynamo graph Filter.FilterByType.dyn (Dynamo 0.9.1.4062)

# group: 1. Click en change. 2. Vas a Revit y seleccionas los elementos que queres filtrar (Clic sostenido en el botón izquierdo del mouse hasta resaltar el area deseada a ser seleccionada.
select_model_elements = DSModelElementsSelection()  # 5 picked in the model

code_block = CodeBlock { "Type"; }
getParameterValueByName = Element.GetParameterValueByName(element=select_model_elements, parameterName=code_block)
string_from_object = FromObject(getParameterValueByName)
uniqueItems = List.UniqueItems(getParameterValueByName)

# group: Si ya seleccionaste los elementos (Nodo azul). 1. Elegi el index de la lista. 2. Run 3. Activa True 4. Run
boolean = BoolSelector(true)
index = CodeBlock { 1; }
watch = Watch(uniqueItems)

code_block_2 = CodeBlock(l=uniqueItems, n=index) { l[n]; }
string_from_object_2 = FromObject(code_block_2)
eq = string_from_object == string_from_object_2
python_script = Python(IN[0]=boolean, IN[1]=eq)
# ---------- python_script.python (11 lines) ----------
import clr
clr.AddReference('ProtoGeometry')
from Autodesk.DesignScript.Geometry import *


bl=IN[0]

if bl == True:
	OUT=IN[1]
else:
	OUT=0
# ----------------------------------------
filterByBoolMask = List.FilterByBoolMask(list=select_model_elements, mask=python_script)
watch_2 = Watch(filterByBoolMask.in)
reset = CodeBlock { true; }
python_script_2 = Python(IN[0]=filterByBoolMask.out, IN[1]=reset)
# ---------- python_script_2.python (36 lines) ----------
#Copyright(c) 2016, Dimitar Venkov
# @5devene, dimitar.ven@gmail.com
#inspired by Julien Benoit @jbenoit44 
#http://aecuandme.wordpress.com/

import clr

clr.AddReference("RevitServices")
import RevitServices
from RevitServices.Persistence import DocumentManager
uidoc = DocumentManager.Instance.CurrentUIApplication.ActiveUIDocument

clr.AddReference("RevitNodes")
import Revit
clr.ImportExtensions(Revit.Elements)

clr.AddReference("RevitAPI")
from Autodesk.Revit.DB import ElementId
clr.AddReference("RevitAPIUI")
from Autodesk.Revit.UI.Selection import *

clr.AddReference("System")
from System.Collections.Generic import List as cList

def tolist(obj1):
	if hasattr(obj1,"__iter__"): return obj1
	else: return [obj1]

elements = UnwrapElement(tolist(IN[0]) )
ids1 = []
for i in xrange(len(elements)):
	try:(ids1.append(elements[i].Id))
	except: pass
ids2 = cList[ElementId](ids1)
uidoc.Selection.SetElementIds(ids2)
OUT = "%s elements selected in Revit." %ids2.Count
# ----------------------------------------
