# Dynamo graph Phase.ChangePhase.dyn (Dynamo 0.9.1.4062)

categories = Categories("Walls")
all_elements_of_category = ElementsOfCategory(categories)
geometry = Element.Geometry(all_elements_of_category)
code_block = CodeBlock { "Phase Created"; }
element_types = ElementTypes("Phase")
all_elements_of_type = ElementsOfType(element_types)
watch = Watch(all_elements_of_type)
code_block_2 = CodeBlock { 1; }
getItemAtIndex = List.GetItemAtIndex(list=watch, index=code_block_2)
setParameterByName = Element.SetParameterByName(element=all_elements_of_category, parameterName=code_block, value=getItemAtIndex)
getParameterValueByName = Element.GetParameterValueByName(element=all_elements_of_category, parameterName=code_block)
watch_2 = Watch(getParameterValueByName)
name = Element.Name(watch_2)
name_2 = Element.Name(watch)
