# Dynamo graph PowerBi.ExportData.dyn (Dynamo 0.9.1.4062)

# group: Directory and image name
directory_path = Directory("C:\Users\Francisco\Desktop\Nueva carpeta")
fileName = StringInput("")

# group: Select view
views = Views("Level 1")
code_block = CodeBlock(file=directory_path, filename=fileName) { file+"/"+filename+".png"; }
exportAsImage = View.ExportAsImage(views, code_block)

# group: Excel file, sheetName, row, col and data
sheetName = StringInput("")
row = DoubleInput(0)
col = DoubleInput(0)
data = List.Create()

writeToFile = Excel.WriteToFile(filePath=directory_path, sheetName=sheetName, startRow=row, startCol=col, data=data)
