# Dynamo graph Rooms.CreateRoomsFromHatch.dyn (Dynamo 0.9.1.4062)

# group: Before to start
# note: You need to install Clockwork Package

# group: Select cada from model. The hatch must be solid
select_model_element = DSModelElementSelection()  # 1 picked in the model

# group: get hatch from cad
geometry = Element.Geometry(select_model_element)
code_block = CodeBlock { "Autodesk.DesignScript.Geometry.Surface"; }
type = Object.Type(geometry)
eq = code_block == type
filterByBoolMask = List.FilterByBoolMask(list=geometry, mask=eq)

# group: get lines from hatch
edges = Face.Edges(filterByBoolMask.in)
curveGeometry = Edge.CurveGeometry(edges)
startPoint = Curve.StartPoint(curveGeometry)
byPoints = Polygon.ByPoints(startPoint)
center = Polygon.Center(byPoints)

# group: Create rooms.
XY = Plane.XY()
byPlane = SketchPlane.ByPlane(XY)
current = Document.Current()
activeView = Document.ActiveView(current)
fromCurve = Custom[RoomSeparator.FromCurve](Curve_s=curveGeometry, Sketch_plane=byPlane, View=activeView)  # Creates room separation lines from geometry curves.

# group: create room boundary
levels = Levels("Level 1")
createRoomAtPointAndLevel = Custom[Tool.CreateRoomAtPointAndLevel](Point_s=center, Level=levels)  # create rooms from center points at Level
