# Dynamo graph Rooms.DeleteZeroRooms.dyn (Dynamo 1.3.3.4111)

# group: Delete zero rooms
categories = Categories("Rooms")
all_elements_of_category = ElementsOfCategory(categories)
code_block = CodeBlock { "Area"; }
getParameterValueByName = Element.GetParameterValueByName(element=all_elements_of_category, parameterName=code_block)
code_block_2 = CodeBlock { "" || 0; }
eq = getParameterValueByName == code_block_2
filterByBoolMask = List.FilterByBoolMask(list=all_elements_of_category, mask=eq)
boolean = BoolSelector(true)
python_script = Python(IN[0]=filterByBoolMask.in, IN[1]=boolean)
# ---------- python_script.python (36 lines) ----------
import clr

clr.AddReference("RevitServices")
import RevitServices
from RevitServices.Persistence import DocumentManager
from RevitServices.Transactions import TransactionManager
doc = DocumentManager.Instance.CurrentDBDocument

def tolist(obj1):
	if hasattr(obj1,"__iter__"): return obj1
	else: return [obj1]

ids = [e.Id for e in UnwrapElement(tolist(IN[0]) )]

if IN[1]:
	deleted = []
	failed = []
	TransactionManager.Instance.EnsureInTransaction(doc)
	for id in ids:
		try:
			del_id = doc.Delete(id)
			del_list = []
			for d in del_id:
				del_list.append(d.ToString())
			deleted.extend(del_list)
		except : failed.append(id.ToString() )
	TransactionManager.Instance.TransactionTaskDone()
	k = set(deleted)
	_failed = []
	for x in failed:
		if x not in k:
			_failed.append(x)
			
	OUT = len(deleted), ';'.join(deleted), ';'.join(_failed)
else:
	OUT = "Set True","",""
# ----------------------------------------
code_block_3 = CodeBlock(d=python_script) { d[0]; d[1]; d[2]; }
watch = Watch(code_block_3.out0)
watch_2 = Watch(code_block_3.out1)
watch_3 = Watch(code_block_3.out2)
