# Dynamo graph Rooms.RenumberByCurve.dyn (Dynamo 1.3.3.4111)

# group: Select model line
select_model_elements = DSModelElementsSelection()
code_block = CodeBlock { 101; }

# group: Get bounding box
categories = Categories("Rooms")
all_elements_of_category = ElementsOfCategory(categories)
boundingBox = Geometry.BoundingBox(all_elements_of_category)
contains = BoundingBox.Contains(boundingBox)  # unwired: arg1
filterByBoolMask = List.FilterByBoolMask(list=all_elements_of_category)  # unwired: mask

# group: Split line
geometry = Element.Geometry(select_model_elements)
code_block_2 = CodeBlock { 10; }
divideEqually = Curve.DivideEqually(geometry, code_block_2)
endPoint = Curve.EndPoint(divideEqually)
flatten = Flatten(endPoint)
map = List.Map(list=flatten, f_x=contains)

# group: Set new number
map_2 = List.Map(list=map, f_x=filterByBoolMask.in)
flatten_2 = Flatten(map_2)
uniqueItems = List.UniqueItems(flatten_2)
code_block_3 = CodeBlock { "Number"; }
prefix = CodeBlock { ""; }
count = Count(uniqueItems)
code_block_4 = CodeBlock(a=code_block, x=count) { a..#x..1; }
string_from_object = FromObject(code_block_4)
code_block_5 = CodeBlock(a=prefix, b=string_from_object) { a+b; }
setParameterByName = Element.SetParameterByName(element=uniqueItems, parameterName=code_block_3, value=code_block_5)
watch = Watch(setParameterByName)
