# Dynamo graph Sections.CreateAndPlaceInSheet.dyn (Dynamo 0.9.1.4062)

element_types = ElementTypes("Grid")
all_elements_of_type = ElementsOfType(element_types)
curve = Grid.Curve(all_elements_of_type)
code_block = CodeBlock { 0.5; }
pointAtParameter = Curve.PointAtParameter(curve=curve, param=code_block)

# group: Make sure all sections are in the same direction
direction = Line.Direction(curve)
code_block_2 = CodeBlock(v1=direction) { v1.X < 0 || v1.Y < 0; }
reverse = Vector.Reverse(direction)
if_ = If(test=code_block_2, true=direction, false=reverse)

code_block_3 = CodeBlock { Vector.ZAxis(); }
byOriginVectors = CoordinateSystem.ByOriginVectors(origin=pointAtParameter, xAxis=if_, yAxis=code_block_3)
length = Curve.Length(curve)
element_types_2 = ElementTypes("Level")
all_elements_of_type_2 = ElementsOfType(element_types_2)
elevation = Level.Elevation(all_elements_of_type_2)
sort = List.Sort(elevation)
firstItem = List.FirstItem(sort)
lastItem = List.LastItem(sort)

# group: Sets width, height and depth of the section
code_block_4 = CodeBlock(len=length, bottom=firstItem, top=lastItem) { w={-1*len/2, len/2}; h={bottom,top}; d={-750,750}; }

byCoordinates = Point.ByCoordinates(x=code_block_4.w, y=code_block_4.h, z=code_block_4.d, lacing=Longest)
code_block_5 = CodeBlock(p=byCoordinates) { p[0]; p[1]; }
byCoordinateSystemMinPointMaxPoint = SectionView.ByCoordinateSystemMinPointMaxPoint(byOriginVectors, code_block_5.out0, code_block_5.out1, lacing=Longest)
code_block_6 = CodeBlock { "View Name"; }
# note: "d" es a cuanta distancia esta de la linea el corte y la designacion
code_block_7 = CodeBlock { "Name"; }
getParameterValueByName = Element.GetParameterValueByName(element=all_elements_of_type, parameterName=code_block_7)
code_block_8 = CodeBlock(a=getParameterValueByName) { "Section axis "+a+" +/-750mm"; }
setParameterByName = Element.SetParameterByName(element=byCoordinateSystemMinPointMaxPoint, parameterName=code_block_6, value=code_block_8)
categories = Categories("Sheets")
all_elements_of_category = ElementsOfCategory(categories)
name = Level.Name(all_elements_of_category)
code_block_9 = CodeBlock { "Reference Sheet"; }
eq = name == code_block_9
filterByBoolMask = List.FilterByBoolMask(list=all_elements_of_category, mask=eq)
getViewport = Custom[View.GetViewport](Sheet=filterByBoolMask.in)  # Get Vieworts from Views
flatten = Flatten(getViewport)
viewPortBoxCenter = Custom[View.ViewPortBoxCenter](Viewports=flatten)  # Get ViewPort Box center point
name_2 = Element.Name(byCoordinateSystemMinPointMaxPoint)
count = Count(byCoordinateSystemMinPointMaxPoint)
code_block_10 = CodeBlock(count=count) { cuenta=1..count; "A"+cuenta; }
family_types = FamilyTypes("A1 metric:A1 metric")
byNameNumberTitleBlockAndView = Sheet.ByNameNumberTitleBlockAndView(sheetName=name_2, sheetNumber=code_block_10.out1, titleBlockFamilyType=family_types, view=byCoordinateSystemMinPointMaxPoint)
getViewport_2 = Custom[View.GetViewport](Sheet=byNameNumberTitleBlockAndView)
flatten_2 = Flatten(getViewport_2)
setBoxCenter = Custom[Viewport.SetBoxCenter](Points=viewPortBoxCenter, Viewport_list=flatten_2)  # API class
