# Dynamo graph Sheets.CreateSheets.dyn (Dynamo 0.9.1.4062)

# group: Set name, number, titleblock, and views. If you create a new one, add again the four parameters.
name = StringInput("Hoja1")
list_of_titleblocks = List.Create(name)
number = StringInput("1")
list_of_titleblocks_2 = List.Create(number)
titleBlock = FamilyTypes("A0 metric:A0 metric")
list_of_view = List.Create(titleBlock)
views = Views("Level 1")
list_of_view_2 = List.Create(views)

# group: Create Sheets. If you need to modify ViewPortBoxCenter set false
boolean = BoolSelector(true)
byNameNumberTitleBlockAndViews = Sheet.ByNameNumberTitleBlockAndViews(list_of_titleblocks, list_of_titleblocks_2, list_of_view, list_of_view_2)
runMe = Custom[Tool.RunMe](Boolean=boolean, ThingToDo=byNameNumberTitleBlockAndViews)  # Use Boolean to perform an action

# group: In this example, Site View is a reference to copy XYZ Coordinate. If you need other location move that view in the sheet
views_2 = Views("Site")
viewPortBoxCenter = Custom[View.ViewPortBoxCenter](Viewports=views_2)  # Get ViewPort Box center point

# group: Set new ubication. Set false if you will do it manually
boolean_2 = BoolSelector(true)
viewports = Custom[Collector.Viewports](RunMe=byNameNumberTitleBlockAndViews)  # This collects all of the viewports in the model and outputs the name, title on sheet, scale and viewport type.
viewPortBoxCenter_2 = Custom[View.ViewPortBoxCenter](Viewports=viewports.Elements)
setBoxCenter = Custom[Viewport.SetBoxCenter](Points=viewPortBoxCenter_2, Viewport_list=viewPortBoxCenter)  # API class
runMe_2 = Custom[Tool.RunMe](Boolean=boolean_2, ThingToDo=setBoxCenter)
