# Dynamo graph Views.Duplicate.dyn (Dynamo 0.9.1.4062)

boolean = BoolSelector(true)
# note: Selecciono vistas del modelo y
# luego agrego el nodo
currentSelection = Custom[Springs.Collector.CurrentSelection](refresh=boolean)  # Gets the currently selected elements. Connect a boolean switch to refresh the selection.
duplicate = Custom[View.Duplicate](View_s=currentSelection)  # Duplicates a given view
code_block = CodeBlock { "View Name"; }
# note: Veo el nombre de la vista que seleccione.
# En este caso es Level 1
name = Element.Name(currentSelection)
code_block_2 = CodeBlock(nombre=name) { nombre+" PLAN"; }
setParameterByName = Element.SetParameterByName(element=duplicate, parameterName=code_block, value=code_block_2)
